# Dynamo graph Create Table With Parameter Names.dyn (Dynamo 1.3.1.1736)

# group: Set Category
categories = Categories("DuctCurves")

# group: Get all elements and their parameters
all_elements_of_category = ElementsOfCategory(categories)
parameters = Element.Parameters(all_elements_of_category)
watch = Watch(parameters)

python_string_from_object = Python(IN[0]=categories)
# ---------- python_string_from_object.python (9 lines) ----------
import clr
clr.AddReference('ProtoGeometry')
from Autodesk.DesignScript.Geometry import *
#The inputs to this node will be stored as a list in the IN variables.
category = IN[0]


#Assign your output to the OUT variable.
OUT = '"' + str(category) + '"'
# ----------------------------------------
table_name = CodeBlock(tableName=python_string_from_object) { tableName; }

# group: Get parameter names
name = Parameter.Name(parameters)
watch_2 = Watch(name)

# group: Create a list of parameter names
code_block = CodeBlock { "Element Id"; }
code_block_2 = CodeBlock { 1; }
flatten = List.Flatten(list=watch_2, amt=code_block_2)
uniqueItems = List.UniqueItems(flatten)
addItemToFront = List.AddItemToFront(item=code_block, list=uniqueItems)
watch_3 = Watch(addItemToFront)

# group: Create table in SQLite db
python_create_string = Python(IN[0]=watch_3)
# ---------- python_create_string.python (12 lines) ----------
import clr
clr.AddReference('ProtoGeometry')
from Autodesk.DesignScript.Geometry import *
#The inputs to this node will be stored as a list in the IN variables.
list1 = IN[0]

#string = string[1:-1]

string = ', '.join('"{0}"'.format(w) for w in list1)

#Assign your output to the OUT variable.
OUT = string
# ----------------------------------------
python_script = Python(IN[0]=table_name, IN[1]=python_create_string)  # unwired: IN[2], IN[3]
# ---------- python_script.python (13 lines) ----------
import clr
clr.AddReference('ProtoGeometry')
from Autodesk.DesignScript.Geometry import *

tableName = IN[0]
stringOfFields = IN[1]

# Create SQL command
sqlCommand = "DROP TABLE IF EXISTS " + tableName + "; \n"
sqlCommand += "CREATE TABLE " + tableName + "(" + stringOfFields + "); \n"

# Output for SQLite command node
OUT = sqlCommand
# ----------------------------------------
watch_4 = Watch(python_script)
file_path = Filename("..\DB\Mechanical.db")
boolean = BoolSelector(true)
SQLite_Command = Database.Command.SQLite_Command(file_path, boolean, python_script)
end = Revit.Transaction.Transaction.End(SQLite_Command)
