# Dynamo graph InsertIntoSqlite.dyn (Dynamo 1.3.0.875)

categories = Categories("DuctCurves")
all_elements_of_category = ElementsOfCategory(categories)

# group: Get element parameters
id = Element.Id(all_elements_of_category)
string_from_object = FromObject(id)
code_block = CodeBlock { "Height"; "Width"; "Diameter"; "Length"; }
getParameterValueByName = Element.GetParameterValueByName(element=all_elements_of_category, parameterName=code_block.out0)
string_from_object_2 = FromObject(getParameterValueByName)
getParameterValueByName_2 = Element.GetParameterValueByName(element=all_elements_of_category, parameterName=code_block.out1)
string_from_object_3 = FromObject(getParameterValueByName_2)
getParameterValueByName_3 = Element.GetParameterValueByName(element=all_elements_of_category, parameterName=code_block.out2)
string_from_object_4 = FromObject(getParameterValueByName_3)
getParameterValueByName_4 = Element.GetParameterValueByName(element=all_elements_of_category, parameterName=code_block.out3)
string_from_object_5 = FromObject(getParameterValueByName_4)

total_elements = List.Count(all_elements_of_category)

# group: Get list of [element id, parameter, ...]
join = List.Join(string_from_object, string_from_object_2, string_from_object_3, string_from_object_4, string_from_object_5)
chop = List.Chop(list=join, lengths=total_elements)
code_block_2 = CodeBlock(list=chop) { list[0]; list[1]; list[2]; list[3]; list[4]; }
py_zips_lists = Python(IN[0]=code_block_2.out0, IN[1]=code_block_2.out1, IN[2]=code_block_2.out2, IN[3]=code_block_2.out3, IN[4]=code_block_2.out4)
# ---------- py_zips_lists.python (12 lines) ----------
import clr
clr.AddReference('ProtoGeometry')
from Autodesk.DesignScript.Geometry import *
#The inputs to this node will be stored as a list in the IN variables.
elementIds = IN[0]
Heights = IN[1]
Widths = IN[2]
Diameters = IN[3]
Lengths = IN[4]

#Assign your output to the OUT variable.
OUT = zip(elementIds, Heights, Widths, Diameters, Lengths)
# ----------------------------------------
watch = Watch(py_zips_lists)
watch_2 = Watch(chop)

# group: Create tableName as <Category>_<datetime.utcnow>
string_from_object_6 = FromObject(categories)
string = StringInput("_")
now = DateTime.Now()
string_from_object_7 = FromObject(now)
py_create_unix_timestamp = Python(IN[0]=string_from_object_7)
# ---------- py_create_unix_timestamp.python (10 lines) ----------
import sys
sys.path.append(r"C:\Program Files (x86)\IronPython 2.7\Lib")
from datetime import datetime
import time
import calendar

now = datetime.utcnow()
str_format = IN[0]

OUT = calendar.timegm(now.utctimetuple())
# ----------------------------------------
string_from_object_8 = FromObject(py_create_unix_timestamp)
concat = String.Concat(string_from_object_6, string, string_from_object_8)
watch_3 = Watch(py_create_unix_timestamp)
tableName = Watch(concat)

# group: Set to True to write to db
py_generate_sql_command = Python(IN[0]=concat, IN[2]=py_zips_lists)  # unwired: IN[1]
# ---------- py_generate_sql_command.python (28 lines) ----------
import clr
clr.AddReference('ProtoGeometry')
from Autodesk.DesignScript.Geometry import *
#The inputs to this node will be stored as a list in the IN variables.
tableName = IN[0]
listOfFields = IN[1]
listOfValues = IN[2]

#listOfValues = [["9999", "1", "3", "5", "7", "9", "11"], ["8888", "2", "4", "6", "8", "10", "12"]]
#tableName = "MechDucts"

# Create dictionary items with first value as key
dictionary = {e[0] : e[0:] for e in listOfValues}

dicString = ", ".join(listOfValues[0])

# Create SQL command
sqlCommand = ""
sqlCommand += "CREATE TABLE " + tableName + " (ElementId INTEGER, Height REAL, Width REAL, Diameter REAL, Length REAL, CONSTRAINT ElementPk PRIMARY KEY (ElementId));\n" + "BEGIN TRANSACTION; \n"

for item in enumerate(listOfValues):
    sqlCommand+=str("INSERT INTO " + tableName +
              "(ElementId, Height, Width, Diameter, Length) " +
              "VALUES (" + "".join(str(item[1]).translate(None, "[]")) + ");\n")
sqlCommand+="COMMIT;"

#Assign your output to the OUT variable.
OUT = sqlCommand
# ----------------------------------------
watch_4 = Watch(py_generate_sql_command)
file_path = Filename("..\..\..\..\..\..\Dev Lab\SeaDUG\Sandbox\SQLite Example\DB\Mechanical.db")
boolean = BoolSelector(false)
SQLite_Command = Database.Command.SQLite_Command(file_path, boolean, py_generate_sql_command)

parameters = Element.Parameters(all_elements_of_category)
watch_5 = Watch(parameters)
id_2 = Element.Id(all_elements_of_category)
watch_6 = Watch(id_2)
code_block_3 = CodeBlock { "Mark"; }
getParameterValueByName_5 = Element.GetParameterValueByName(element=all_elements_of_category, parameterName=code_block_3)
watch_7 = Watch(getParameterValueByName_5)
gets_an_element_s_parameters = CodeBlock(x=parameters) { x; }
watch_8 = Watch(gets_an_element_s_parameters)
string_from_object_9 = FromObject(gets_an_element_s_parameters)

# group: Get keys
code_block_4 = CodeBlock { " : "; }
indexOf = String.IndexOf(string=string_from_object_9, searchFor=code_block_4)
length = String.Length(string_from_object_9)
remove_characters_after_key = CodeBlock(length=length, split=indexOf) { length-split; }
remove = String.Remove(str=string_from_object_9, startIndex=indexOf, count=remove_characters_after_key)
watch_9 = Watch(remove)

watch_10 = Watch()  # unwired: arg0
getKeys = GetKeys()  # unwired: arg0
byKeysValues = Custom[Springs.Dictionary.ByKeysValues]()  # Dictionaries are an incredibly powerful tool for making associative sets between two equal length lists. The first list must be of unique strings (or numbers) and will be the key and the second list will be the matching values (it can be made up of geometry, elements, even other lists) The search keys list will provide the corresponding value to the input key.; unwired: keys, values, searchKeys

# group: Get values
code_block_5 = CodeBlock { 0; }
code_block_6 = CodeBlock { " : "; }
indexOf_2 = String.IndexOf(string=string_from_object_9, searchFor=code_block_6)
code_block_7 = CodeBlock(index=indexOf_2) { index+3; }
remove_2 = String.Remove(str=string_from_object_9, startIndex=code_block_5, count=code_block_7)
watch_11 = Watch(remove_2)
length_2 = String.Length(string_from_object_9)

insert = Insert()  # unwired: arg0, arg1, arg2
code_block_8 = CodeBlock { "Element Id : " +x; }  # unwired: x
concat_2 = String.Concat(code_block_8)  # unwired: arg1
string_from_object_10 = FromObject(id_2)
python_script = Python(IN[0]=gets_an_element_s_parameters)  # starter script, not edited (OUT = 0)
python_script_2 = Python(IN[0]=remove, IN[1]=remove_2)
# ---------- python_script_2.python (30 lines) ----------
import clr
clr.AddReference('ProtoGeometry')
from Autodesk.DesignScript.Geometry import *
import sys
sys.path.append(r'C:\Program Files (x86)\IronPython 2.7\DLLs')
sys.path.append(r'C:\Program Files (x86)\IronPython 2.7\Lib')
import itertools

#The inputs to this node will be stored as a list in the IN variables.
keys = IN[0]
values = IN[1]
keysTuple = tuple(keys)
valuesTuple = tuple(values)

testKeys = []
testValues = []


for k in keys[0]:
	testKeys.append(str(k))
	
for v in values[0]:
	testValues.append(str(v))
	
myDic = dict(zip(testKeys,testValues))

#Assign your output to the OUT variable.
OUT = str(myDic)
#OUT = myDic.get("Category", "N/A")
#OUT = str(testKeys)
# ----------------------------------------
watch_12 = Watch(python_script_2)
